# Grasshopper definition 01-03_WetterSimple_Sobol.gh (Grasshopper 0.9.76)
# plug-ins: GHEnergyPlus

templates_idf = Panel("""simple_chicago_template
simple_houston_template
simple_seattle_template""")
weather_files = Panel("""USA_IL_Chicago-OHare.725300_TMY2
USA_TX_Houston-Intercontinental.722430_TMY2
USA_WA_Seattle-Tacoma.727930_TMY2""")
list = ValueList({"Chicago": 0, "Houston": 1, "Seattle": 2}, selected="Chicago")
item = ListItem(List=templates_idf, Index=list, Wrap=False)
item_2 = ListItem(List=weather_files, Index=list, Wrap=False)
wettersimplesobol = WetterSimpleSobol(
    IdfFile=item,
    WeatherFile=item_2,
    PathLPtSequence="C:\eplus\EPOpti17\Input0\input_n4_allWalks.csv",
    Run=Toggle(False),
    Folder="0")
