# Grasshopper definition WetterSimpleSobol.gh (Grasshopper 0.9.76)
# plug-ins: GHEnergyPlus

templates_idf = Panel("""simple_template_chicago
simple_template_houston
simple_template_seattle""")
weather_files = Panel("""USA_IL_Chicago-OHare.725300_TMY2
USA_TX_Houston-Intercontinental.722430_TMY2
USA_WA_Seattle-Tacoma.727930_TMY2""")
list = ValueList({"Chicago": 0, "Houston": 1, "Seattle": 2}, selected="Seattle")
item = ListItem(List=templates_idf, Index=list, Wrap=False)
item_2 = ListItem(List=weather_files, Index=list, Wrap=False)
wettersimplesobol = WetterSimpleSobol(IdfFile=item, WeatherFile=item_2, PathLPtSequence="C:\eplus\EPOpti17\Input0\Sobol.csv", Run=Toggle(False), Folder="0")
