# Grasshopper definition WetterSimple_continuous.gh (Grasshopper 0.9.76)
# plug-ins: FrOG, GHEnergyPlus

# ---- group: run it
toggle = BooleanToggle(False)

# ----
templates_idf = Panel("""simple_template_chicago
simple_template_houston
simple_template_seattle""")
weather_files = Panel("""USA_IL_Chicago-OHare.725300_TMY2
USA_TX_Houston-Intercontinental.722430_TMY2
USA_WA_Seattle-Tacoma.727930_TMY2""")

# ---- group: parameters
number_slider = Slider(80.3, range=-180..180)
number_slider_2 = Slider(5.9, range=0.1..5.9)
number_slider_3 = Slider(5.9, range=0.1..5.9)
number_slider_4 = Slider(0.538, range=0.2..0.8)

# ----
list = ValueList({"Chicago": 0, "Houston": 1, "Seattle": 2}, selected="Seattle")
item = ListItem(List=templates_idf, Index=list, Wrap=False)
item_2 = ListItem(List=weather_files, Index=list, Wrap=False)
wettersimplepara = WetterSimplePara(
    Idf=item,
    Weather=item_2,
    Run=toggle,
    Orientation=number_slider,
    WindowLW=number_slider_2,
    WindowLE=number_slider_3,
    Transmittance=number_slider_4,
    Folder="0")
framework_for_optimization_in_grasshoppe = FrOG01(Variables=[number_slider, number_slider_2, number_slider_3, number_slider_4], Objective=wettersimplepara)  # "Framework for Optimization in Grasshopper"

# ---- group: result
panel = Panel(wettersimplepara)
