# Grasshopper definition 04-08_WetterDetailed_Sobol.gh (Grasshopper 0.9.76)
# plug-ins: GHEnergyPlus

templates_idf = Panel("""detailed_chicago_template
detailed_houston_template
detailed_seattle_template""")
weather_files = Panel("""USA_IL_Chicago-OHare.725300_TMY2
USA_TX_Houston-Intercontinental.722430_TMY2
USA_WA_Seattle-Tacoma.727930_TMY2""")
list = ValueList({"Chicago": 0, "Houston": 1, "Seattle": 2}, selected="Chicago")
item = ListItem(List=templates_idf, Index=list, Wrap=False)
item_2 = ListItem(List=weather_files, Index=list, Wrap=False)
wetterdetailedsobol = WetterDetailedSobol(
    IdfFile=item,
    WeatherFile=item_2,
    PathLPtSequence="C:\eplus\EPOpti17\Input3\input_n13_allWalks.csv",
    Run=Toggle(False),
    Folder="3")
