# Grasshopper definition WetterDetailedSobol.gh (Grasshopper 0.9.76)
# plug-ins: GHEnergyPlus

templates_idf = Panel("""detailed_chicago_template
detailed_houston_template
detailed_seattle_template""")
weather_files = Panel("""USA_IL_Chicago-OHare.725300_TMY2
USA_TX_Houston-Intercontinental.722430_TMY2
USA_WA_Seattle-Tacoma.727930_TMY2""")
panel = Panel("H:\PROJEKTE\16_Optimizers\4_CASESTUDY\Journal_Thomas\01_Wetter Wright\detailed\sensitivity\test2.csv")
list = ValueList({"Chicago": 0, "Houston": 1, "Seattle": 2}, selected="Chicago")
item = ListItem(List=templates_idf, Index=list, Wrap=False)
item_2 = ListItem(List=weather_files, Index=list, Wrap=False)
wetterdetailedsobol = WetterDetailedSobol(IdfFile=item, WeatherFile=item_2, PathLPtSequence=panel, Run=Toggle(False))
