# Grasshopper definition WetterDetailed_continuous.gh (Grasshopper 0.9.76)
# plug-ins: FrOG, GHEnergyPlus

# ---- group: run it
toggle = BooleanToggle(False)

# ----
templates_idf = Panel("""detailed_chicago_template
detailed_houston_template
detailed_seattle_template""")
weather_files = Panel("""USA_IL_Chicago-OHare.725300_TMY2
USA_TX_Houston-Intercontinental.722430_TMY2
USA_WA_Seattle-Tacoma.727930_TMY2""")

# ---- group: parameters
_01_window_n = Slider(0.783, range=0..1)
_02_window_w = Slider(0.519, range=0..1)
_03_overhang_w = Slider(0.67, range=0..1)
_04_window_e = Slider(0.761, range=0..1)
_05_overhang_e = Slider(0.409, range=0..1)
_06_window_s = Slider(0.694, range=0..1)
_07_overhang_s = Slider(0.373, range=0..1)
_08_shading_w = Slider(324.8, range=100..600)
_09_shading_e = Slider(258.5, range=100..600)
_10_shading_s = Slider(369.6, range=100..600)
_11_setpoint_summer = Slider(23.91, range=20..25)
_12_setpoint_winter = Slider(23.24, range=20..25)
_13_setpoint_cooling = Slider(12.38, range=12..18)

# ----
list = ValueList({"Chicago": 0, "Houston": 1, "Seattle": 2}, selected="Seattle")
expression = Expression(x=_03_overhang_w, Expression="x+0.05")
expression_2 = Expression(x=_05_overhang_e, Expression="x+0.05")
expression_3 = Expression(x=_01_window_n, Expression="x*4.608+1.224")
expression_4 = Expression(x=_06_window_s, Expression="x*4.608+1.224")
expression_5 = Expression(x=_02_window_w, Expression="x*18.324+7.344")
expression_6 = Expression(x=_07_overhang_s, Expression="x+0.05")
expression_7 = Expression(x=_04_window_e, Expression="x*18.324+7.344")
item = ListItem(List=templates_idf, Index=list, Wrap=False)
item_2 = ListItem(List=weather_files, Index=list, Wrap=False)
wetterdetailedpara = WetterDetailedPara(
    Idf=item,
    Weather=item_2,
    Run=toggle,
    WindowLN=expression_3,
    WindowLW=expression_5,
    WindowLE=expression_7,
    WindowLS=expression_4,
    OverhangW=expression,
    OverhangE=expression_2,
    OverhangS=expression_6,
    ShadingW=_08_shading_w,
    ShadingE=_09_shading_e,
    ShadingS=_10_shading_s,
    SetpointNightSummer=_11_setpoint_summer,
    SetpointNightWinter=_12_setpoint_winter,
    CoolingSupplyTemp=_13_setpoint_cooling,
    Folder="2")
framework_for_optimization_in_grasshoppe = FrOG01(
    Variables=[_01_window_n, _02_window_w, _03_overhang_w, _04_window_e, _05_overhang_e, _06_window_s, _07_overhang_s, _08_shading_w, _09_shading_e, _10_shading_s, _11_setpoint_summer, _12_setpoint_winter, _13_setpoint_cooling],
    Objective=wetterdetailedpara)  # "Framework for Optimization in Grasshopper"

# ---- group: result
panel = Panel(wetterdetailedpara)
