# Grasshopper definition WetterDetailed_discrete.gh (Grasshopper 0.9.76)
# plug-ins: GHEnergyPlus, Opossum

# ---- group: run it
toggle = BooleanToggle(False)

# ---- group: parameters
_01_window_n = Slider(20, range=0..20)
_02_window_w = Slider(20, range=0..20)
_03_overhang_w = Slider(20, range=0..20)
_04_window_e = Slider(20, range=0..20)
_05_overhang_e = Slider(20, range=0..20)
_06_window_s = Slider(20, range=0..20)
_07_overhang_s = Slider(20, range=0..20)
_08_shading_w = Slider(20, range=0..20)
_09_shading_e = Slider(20, range=0..20)
_10_shading_s = Slider(20, range=0..20)
_11_setpoint_summer = Slider(20, range=0..20)
_12_setpoint_winter = Slider(20, range=0..20)
_13_setpoint_cooling = Slider(24, range=0..24)

# ----
templates_idf = Panel("""detailed_chicago_template
detailed_houston_template
detailed_seattle_template""")
weather_files = Panel("""USA_IL_Chicago-OHare.725300_TMY2
USA_TX_Houston-Intercontinental.722430_TMY2
USA_WA_Seattle-Tacoma.727930_TMY2""")
expression = Expression(x=_01_window_n, Expression="x*0.05*4.608+1.224")
expression_2 = Expression(x=_02_window_w, Expression="x*0.05*18.324+7.344")
expression_3 = Expression(x=_06_window_s, Expression="x*0.05*4.608+1.224")
expression_4 = Expression(x=_04_window_e, Expression="x*0.05*18.324+7.344")
expression_5 = Expression(x=_05_overhang_e, Expression="x*0.05+0.05")
expression_6 = Expression(x=_07_overhang_s, Expression="x*0.05+0.05")
expression_7 = Expression(x=_03_overhang_w, Expression="x*0.05+0.05")
expression_8 = Expression(x=_10_shading_s, Expression="x*25+100")
expression_9 = Expression(x=_08_shading_w, Expression="x*25+100")
expression_10 = Expression(x=_09_shading_e, Expression="x*25+100")
expression_11 = Expression(x=_11_setpoint_summer, Expression="x*0.25+20")
expression_12 = Expression(x=_12_setpoint_winter, Expression="x*0.25+20")
expression_13 = Expression(x=_13_setpoint_cooling, Expression="x*0.25+12")
list = ValueList({"Chicago": 0, "Houston": 1, "Seattle": 2}, selected="Chicago")
item = ListItem(List=templates_idf, Index=list, Wrap=False)
item_2 = ListItem(List=weather_files, Index=list, Wrap=False)
wetterdetailedpara = WetterDetailedPara(
    Idf=item,
    Weather=item_2,
    Run=toggle,
    WindowLN=expression,
    WindowLW=expression_2,
    WindowLE=expression_4,
    WindowLS=expression_3,
    OverhangW=expression_7,
    OverhangE=expression_5,
    OverhangS=expression_6,
    ShadingW=expression_9,
    ShadingE=expression_10,
    ShadingS=expression_8,
    SetpointNightSummer=expression_11,
    SetpointNightWinter=expression_12,
    CoolingSupplyTemp=expression_13)
opitmization_solver_with_surrogate_model = Opossum(
    fitness=wetterdetailedpara,
    gene=[_01_window_n, _06_window_s, _02_window_w, _04_window_e, _03_overhang_w, _05_overhang_e, _07_overhang_s, _08_shading_w, _09_shading_e, _10_shading_s, _11_setpoint_summer, _12_setpoint_winter, _13_setpoint_cooling])  # "Opitmization Solver with Surrogate Models"

# ---- group: result
panel = Panel(wetterdetailedpara)
