# Grasshopper definition WetterDetailed_reduced.gh (Grasshopper 0.9.76)
# plug-ins: FrOG, GHEnergyPlus

# ---- group: run it
toggle = BooleanToggle(False)

# ----
templates_idf = Panel("""detailed_chicago_template
detailed_houston_template
detailed_seattle_template""")
weather_files = Panel("""USA_IL_Chicago-OHare.725300_TMY2
USA_TX_Houston-Intercontinental.722430_TMY2
USA_WA_Seattle-Tacoma.727930_TMY2""")

_01_window_n = Slider(0.9998, range=0..1)
_02_window_w = Slider(0.4173, range=0..1)
_03_overhang_w = Slider(0.3537, range=0..1)
_04_window_e = Slider(0.4915, range=0..1)
_05_overhang_e = Slider(0.3031, range=0..1)
_06_window_s = Slider(1, range=0..1)
_07_overhang_s = Slider(0.3508, range=0..1)
_08_shading_w = Slider(192.9, range=100..600)
_09_shading_e = Slider(180.2, range=100..600)
_10_shading_s = Slider(192.4, range=100..600)
_12_setpoint_winter = Slider(23.97, range=20..25)
num = Number("25")
num_2 = Number("12")

list = ValueList({"Chicago": 0, "Houston": 1, "Seattle": 2}, selected="Chicago")
expression = Expression(x=_01_window_n, Expression="x*4.608+1.224")
expression_2 = Expression(x=_02_window_w, Expression="x*18.324+7.344")
expression_3 = Expression(x=_03_overhang_w, Expression="x+0.05")
expression_4 = Expression(x=_04_window_e, Expression="x*18.324+7.344")
expression_5 = Expression(x=_05_overhang_e, Expression="x+0.05")
expression_6 = Expression(x=_06_window_s, Expression="x*4.608+1.224")
expression_7 = Expression(x=_07_overhang_s, Expression="x+0.05")
item = ListItem(List=templates_idf, Index=list, Wrap=False)
item_2 = ListItem(List=weather_files, Index=list, Wrap=False)
wetterdetailedpara = WetterDetailedPara(
    Idf=item,
    Weather=item_2,
    Run=toggle,
    WindowLN=expression,
    WindowLW=expression_2,
    WindowLE=expression_4,
    WindowLS=expression_6,
    OverhangW=expression_3,
    OverhangE=expression_5,
    OverhangS=expression_7,
    ShadingW=_08_shading_w,
    ShadingE=_09_shading_e,
    ShadingS=_10_shading_s,
    SetpointNightSummer=num,
    SetpointNightWinter=_12_setpoint_winter,
    CoolingSupplyTemp=num_2,
    Sleep=Slider(100, range=0..10000),
    Folder=Slider(0, range=0..5))
# Initial, Houston: Wetter Wright 2004
# 165.40 kWh/m2a
# 
# Chris + Thomas 2016
# 182.62 kWh/m2a
# Best Iterate, Houston: Wetter Wright 2004
# 141.45 kWh/m2a
# 
# Chris + Thomas 2016
# 144.43 kWh/m2a
# Initial, Seattle: Wetter Wright 2004
# 114.60 kWh/m2a
# 
# Chris + Thomas 2016
# 128.72 kWh/m2a
framework_for_optimization_in_grasshoppe = FrOG01(
    Variables=[_01_window_n, _02_window_w, _03_overhang_w, _04_window_e, _05_overhang_e, _06_window_s, _07_overhang_s, _08_shading_w, _09_shading_e, _10_shading_s, _12_setpoint_winter],
    Objective=wetterdetailedpara)  # "Framework for Optimization in Grasshopper"
objective = Number(wetterdetailedpara)

# ---- group: result
# Best Iterate, Seattle: Wetter Wright 2004
# 95.82 kWh/m2a
# 
# Chris + Thomas 2016
# 106.83 kWh/m2a
panel = Panel(objective)
