# Grasshopper definition 10_KämpfLarge_Sobol.gh (Grasshopper 0.9.76)
# plug-ins: GHEnergyPlus

templates_idf = Panel("problem_10_template")
weather_files = Panel("USA_CA_San.Francisco.Intl.AP_TMY3")
list = ValueList({"San Francisco": 0}, selected="San Francisco")
item = ListItem(List=templates_idf, Index=list, Wrap=False)
item_2 = ListItem(List=weather_files, Index=list, Wrap=False)

# ---- group: run it
toggle = BooleanToggle(False)

# ----
sobol10 = Sobol10Kämpf(
    IdfFile=item,
    WeatherFile=item_2,
    PathLPtSequence="C:\eplus\EPOpti17\Input9\input_n13_allWalks.csv",
    Run=toggle,
    Folder="9")
