# Grasshopper definition Problem10.gh (Grasshopper 0.9.76)
# plug-ins: GHEnergyPlus

# ---- group: run it
toggle = BooleanToggle(False)

# ----
templates_idf = Panel("problem_10_template")
weather_files = Panel("USA_CA_San.Francisco.Intl.AP_TMY3")
list = ValueList({"San Francisco": 0}, selected="San Francisco")
item = ListItem(List=templates_idf, Index=list, Wrap=False)
item_2 = ListItem(List=weather_files, Index=list, Wrap=False)
prob10kämpf = Prob10Kämpf(
    Idf=item,
    Weather=item_2,
    Run=toggle,
    Folder="0",
    N_win_low=Slider(1, range=0.8..1.25),
    N_win_up=Slider(1.35, range=1.35..2.2),
    E_win_low=Slider(0.8, range=0.8..1.25),
    E_win_up=Slider(1.35, range=1.35..2.2),
    S_win_low=Slider(0.8, range=0.8..1.25),
    S_win_up=Slider(1.35, range=1.35..2.2),
    W_win_low=Slider(0.8, range=0.8..1.25),
    W_win_up=Slider(1.35, range=1.35..2.2),
    CoolSup=Slider(12, range=12..18),
    HeatSB_1=Slider(13, range=13..21),
    HeatSB_2=Slider(13, range=13..21),
    CoolSB_1=Slider(24, range=24..36),
    CoolSB_2=Slider(24, range=24..36))

# ---- group: result
panel = Panel(prob10kämpf)
