# Grasshopper definition 11_NguyenNatVent_Sobol.gh (Grasshopper 0.9.76)
# plug-ins: GHEnergyPlus

weather_files = Panel("VNM_Hanoi.488200_IWEC")
templates_idf = Panel("HN_NV_Adaptive_template")
list = ValueList({"Hanoi": 0}, selected="Hanoi")
item = ListItem(List=templates_idf, Index=list, Wrap=False)
item_2 = ListItem(List=weather_files, Index=list, Wrap=False)
sobol11a_nv = Sobol11NguyenA_NV(
    IdfFile=item,
    WeatherFile=item_2,
    PathLPtSequence="C:\eplus\EPOpti17\Input0\Nguyen_A2.csv",
    Run=Toggle(False),
    Folder="0")
