# Grasshopper definition 12_NguyenCost_Sobol.gh (Grasshopper 0.9.76)
# plug-ins: GHEnergyPlus

weather_files = Panel("VNM_Hanoi.488200_IWEC")
templates_idf = Panel("HN_AC_AdaptiveSP_template")
list = ValueList({"Hanoi": 0}, selected="Hanoi")
item = ListItem(List=templates_idf, Index=list, Wrap=False)
item_2 = ListItem(List=weather_files, Index=list, Wrap=False)
sobol12a_nv = Sobol12NguyenA_NV(
    IdfFile=item,
    WeatherFile=item_2,
    PathLPtSequence="C:\eplus\EPOpti17\Input0\Nguyen_C2_rhino.csv",
    Run=Toggle(False),
    Folder="1")
