# Grasshopper definition 13_DjuricSchool_Sobol.gh (Grasshopper 0.9.76)
# plug-ins: GHEnergyPlus

weather_files = Panel("YUG_Belgrade_IWEC")
templates_idf = Panel("Problem13_template")
list = ValueList({"Belgrade": 0}, selected="Belgrade")
item = ListItem(List=templates_idf, Index=list, Wrap=False)
item_2 = ListItem(List=weather_files, Index=list, Wrap=False)
sobol13 = Sobol13Djuric(
    IdfFile=item,
    WeatherFile=item_2,
    PathLPtSequence="C:\eplus\EPOpti17\Input0\Sobol13_input.csv",
    Run=Toggle(False),
    Folder="0")
