# Grasshopper definition Problem13.gh (Grasshopper 0.9.76)
# plug-ins: FrOG, GHEnergyPlus

# ---- group: run it
toggle = BooleanToggle(False)

# ----
templates_idf = Panel("Problem13_template")
weather_files = Panel("YUG_Belgrade_IWEC")
number_slider = Slider(0.05, range=0.05..0.3)
number_slider_2 = Slider(120, range=60..120)
number_slider_3 = Slider(110, range=80..160)
number_slider_4 = Slider(400, range=400..800)
number_slider_5 = Slider(50, range=20..50)
list = ValueList({"Belgrade": 0}, selected="Belgrade")
number_slider_6 = Slider(110, range=50..110)
number_slider_7 = Slider(80, range=80..180)
number_slider_8 = Slider(140, range=140..280)
number_slider_9 = Slider(380, range=380..760)
number_slider_10 = Slider(380, range=350..700)
item = ListItem(List=templates_idf, Index=list, Wrap=False)
item_2 = ListItem(List=weather_files, Index=list, Wrap=False)
prob13djuric = Prob13Djuric(
    Idf=item,
    Weather=item_2,
    Run=toggle,
    Sleep="100",
    Folder="0",
    Delta=number_slider,
    X_1=number_slider_4,
    X_2=number_slider_2,
    X_3=number_slider_6,
    X_4=number_slider_3,
    X_5=number_slider_5,
    X_6=number_slider_7,
    X_7=number_slider_8,
    X_8=number_slider_9,
    X_9=number_slider_10)
framework_for_optimization_in_grasshoppe = FrOG01(
    Variables=[number_slider, number_slider_4, number_slider_2, number_slider_6, number_slider_3, number_slider_5, number_slider_7, number_slider_8, number_slider_9, number_slider_10],
    Objective=prob13djuric)  # "Framework for Optimization in Grasshopper"

# ---- group: result
panel = Panel(prob13djuric)
