# Grasshopper definition 14_AlfonsoOffice_Sobol.gh (Grasshopper 0.9.76)
# plug-ins: GHEnergyPlus

weather_files = Panel("GBR_London.Gatwick.037760_IWEC")
templates_idf = Panel("problem_14_template")
list = ValueList({"Gatwick": 0}, selected="Gatwick")
item = ListItem(List=templates_idf, Index=list, Wrap=False)
item_2 = ListItem(List=weather_files, Index=list, Wrap=False)
sobol14 = Sobol14Gonzalez(
    IdfFile=item,
    WeatherFile=item_2,
    PathLPtSequence="C:\eplus\EPOpti17\Input0\Problem_14_input.csv",
    Run=Toggle(False),
    Folder="0")
