# Grasshopper definition Problem14.gh (Grasshopper 0.9.76)
# plug-ins: FrOG, GHEnergyPlus

# ---- group: run it
toggle = BooleanToggle(False)

# ----
number_slider = Slider(1, range=1..4)
templates_idf = Panel("problem_14_template")
weather_files = Panel("GBR_London.Gatwick.037760_IWEC")
number_slider_2 = Slider(0.01, range=0.01..5)
number_slider_3 = Slider(0.01, range=0.01..5)
number_slider_4 = Slider(0.01, range=0.01..2)
number_slider_5 = Slider(100, range=100..500)
number_slider_6 = Slider(0.3, range=0.3..3)
number_slider_7 = Slider(0.8, range=0.12..0.8)
number_slider_8 = Slider(0.8, range=0.12..0.8)
number_slider_9 = Slider(0.01, range=0.01..5)
number_slider_10 = Slider(2.4, range=0.2..2.4)
number_slider_11 = Slider(0.433255, range=0.021..0.6)
number_slider_12 = Slider(0.01, range=0.01..5)
number_slider_13 = Slider(0.01, range=0.01..2)
number_slider_14 = Slider(1.7, range=1.7..5.2)
number_slider_15 = Slider(0.8, range=0.12..0.8)
number_slider_16 = Slider(0.8, range=0.12..0.8)
number_slider_17 = Slider(200, range=200..3000)
number_slider_18 = Slider(0.01, range=0.01..5)
number_slider_19 = Slider(0.01, range=0.01..2)
number_slider_20 = Slider(0.01, range=0.01..5)
list = ValueList({"LondonGatwick": 0}, selected="LondonGatwick")
item = ListItem(List=templates_idf, Index=list, Wrap=False)
item_2 = ListItem(List=weather_files, Index=list, Wrap=False)
prob14gonzalez = Prob14Gonzalez(
    Idf=item,
    Weather=item_2,
    Run=toggle,
    Sleep="100",
    Folder="0",
    Infiltration=number_slider_11,
    AspectRatio=number_slider_6,
    UValueWindows=number_slider_14,
    FenestrationNorth=number_slider_7,
    FenestrationSouth=number_slider_15,
    FenestrationEast=number_slider_8,
    FenestrationWest=number_slider_16,
    WallType=number_slider,
    Insulation=number_slider_5,
    Conductivity=number_slider_10,
    X_10=number_slider_17,
    Overhang_S_depth=number_slider_19,
    Overhang_S_left=number_slider_20,
    Overhang_S_right=number_slider_18,
    Overhang_E_depth=number_slider_13,
    Overhang_E_left=number_slider_9,
    Overhang_E_right=number_slider_12,
    Overhang_W_depth=number_slider_4,
    Overhang_W_left=number_slider_2,
    Overhang_W_right=number_slider_3)
framework_for_optimization_in_grasshoppe = FrOG01(
    Variables=[number_slider_11, number_slider_6, number_slider_14, number_slider_7, number_slider_15, number_slider_8, number_slider_16, number_slider, number_slider_5, number_slider_10, number_slider_17, number_slider_19, number_slider_20, number_slider_18, number_slider_13, number_slider_9, number_slider_12, number_slider_4, number_slider_2, number_slider_3],
    Objective=prob14gonzalez)  # "Framework for Optimization in Grasshopper"

# ---- group: result
panel = Panel(prob14gonzalez)
