# Grasshopper definition 15_WaibelForm_Sobol.gh (Grasshopper 0.9.76)
# plug-ins: GHEnergyPlus

templates_idf = Panel("Problem15_template")
weather_files = Panel("CH_ZH_original")
list = ValueList({"Zueri": 0}, selected="Zueri")
item = ListItem(List=templates_idf, Index=list, Wrap=False)
item_2 = ListItem(List=weather_files, Index=list, Wrap=False)
sobol15 = Sobol15Waibel(
    IdfFile=item,
    WeatherFile=item_2,
    PathLPtSequence="C:\eplus\EPOpti17\Input0\Problem_15_input0.csv",
    Run=Toggle(False),
    Folder="0")
