# Grasshopper definition Case03.gh (Grasshopper 0.9.76)
# plug-ins: GHEnergyPlus

# ---- group: run it
toggle = BooleanToggle(False)

# ---- group: integers
number_slider = Slider(1, range=1..6)
number_slider_2 = Slider(1, range=1..6)
number_slider_3 = Slider(1, range=1..6)
number_slider_4 = Slider(1, range=1..6)

# ----
templates_idf = Panel("Case02_template")
weather_files = Panel("CH_ZH_original")
list = ValueList({"Zueri": 0}, selected="Zueri")
item = ListItem(List=templates_idf, Index=list, Wrap=False)
item_2 = ListItem(List=weather_files, Index=list, Wrap=False)
prob15_zurich = Prob15_Zurich(
    Idf=item,
    Weather=item_2,
    Run=toggle,
    Sleep="100",
    Folder="0",
    BldAfloors=number_slider_3,
    BldBfloors=number_slider_4,
    BldCfloors=number_slider_2,
    BldDfloors=number_slider,
    BldA_X1=Slider(1, range=0..1),
    BldA_Y1=Slider(1, range=0..1),
    BldA_X2=Slider(1, range=0..1),
    BldA_Y2=Slider(1, range=0..1),
    BldA_X3=Slider(1, range=0..1),
    BldA_Y3=Slider(1, range=0..1),
    BldA_X4=Slider(1, range=0..1),
    BldA_Y4=Slider(1, range=0..1),
    BldB_X1=Slider(1, range=0..1),
    BldB_Y1=Slider(1, range=0..1),
    BldB_X2=Slider(1, range=0..1),
    BldB_Y2=Slider(1, range=0..1),
    BldB_X3=Slider(1, range=0..1),
    BldB_Y3=Slider(1, range=0..1),
    BldB_X4=Slider(1, range=0..1),
    BldB_Y4=Slider(1, range=0..1),
    BldC_X1=Slider(1, range=0..1),
    BldC_Y1=Slider(1, range=0..1),
    BldC_X2=Slider(1, range=0..1),
    BldC_Y2=Slider(1, range=0..1),
    BldC_X3=Slider(1, range=0..1),
    BldC_Y3=Slider(1, range=0..1),
    BldC_X4=Slider(1, range=0..1),
    BldC_Y4=Slider(1, range=0..1),
    BldD_X1=Slider(1, range=0..1),
    BldD_Y1=Slider(1, range=0..1),
    BldD_X2=Slider(1, range=0..1),
    BldD_Y2=Slider(1, range=0..1),
    BldD_X3=Slider(1, range=0..1),
    BldD_Y3=Slider(1, range=0..1),
    BldD_X4=Slider(1, range=0..1),
    BldD_Y4=Slider(1, range=0..1))  # -> Elec, Cool, DHW, SH, Area
