# Grasshopper definition Problem15.gh (Grasshopper 0.9.76)
# plug-ins: FrOG, GHEnergyPlus

# ---- group: run it
toggle = BooleanToggle(False)

# ---- group: integers
number_slider = Slider(1, range=1..6)
number_slider_2 = Slider(1, range=1..6)
number_slider_3 = Slider(1, range=1..6)
number_slider_4 = Slider(1, range=1..6)

# ----
templates_idf = Panel("Problem15_template")
weather_files = Panel("CH_ZH_original")

# ---- group: real
number_slider_5 = Slider(0, range=0..9.5)
number_slider_6 = Slider(0, range=0..9.5)
number_slider_7 = Slider(6.044, range=0..9.5)
number_slider_8 = Slider(0, range=0..9.5)
number_slider_9 = Slider(6.807, range=0..9.5)
number_slider_10 = Slider(0, range=0..9.5)
number_slider_11 = Slider(8.828, range=0..9.5)
number_slider_12 = Slider(6.721, range=0..9.5)
number_slider_13 = Slider(0, range=0..9.5)
number_slider_14 = Slider(4.84, range=0..9.5)
number_slider_15 = Slider(6.732, range=0..9.5)
number_slider_16 = Slider(1.228, range=0..9.5)
number_slider_17 = Slider(9.5, range=0..9.5)
number_slider_18 = Slider(0.626, range=0..9.5)
number_slider_19 = Slider(1.83, range=0..9.5)
number_slider_20 = Slider(0.772, range=0..9.5)
number_slider_21 = Slider(9.5, range=0..9.5)
number_slider_22 = Slider(3.442, range=0..9.5)
number_slider_23 = Slider(0, range=0..9.5)
number_slider_24 = Slider(8.979, range=0..9.5)
number_slider_25 = Slider(7.394, range=0..9.5)
number_slider_26 = Slider(9.5, range=0..9.5)
number_slider_27 = Slider(9.5, range=0..9.5)
number_slider_28 = Slider(2.056, range=0..9.5)
number_slider_29 = Slider(5.442, range=0..9.5)
number_slider_30 = Slider(0.25, range=0..9.5)
number_slider_31 = Slider(5.517, range=0..9.5)
number_slider_32 = Slider(9.5, range=0..9.5)
number_slider_33 = Slider(7.318, range=0..9.5)
number_slider_34 = Slider(5, range=0..5)
number_slider_35 = Slider(5, range=0..5)

# ----
list = ValueList({"Zueri": 0}, selected="Zueri")
item = ListItem(List=templates_idf, Index=list, Wrap=False)
item_2 = ListItem(List=weather_files, Index=list, Wrap=False)
prob15waibel = Prob15Waibel(
    Idf=item,
    Weather=item_2,
    Run=toggle,
    Sleep="100",
    Folder="0",
    BldAfloors=number_slider_3,
    BldBfloors=number_slider_4,
    BldCfloors=number_slider_2,
    BldDfloors=number_slider,
    BldA_X1=number_slider_30,
    BldA_Y1=number_slider_29,
    BldA_X2=number_slider_33,
    BldA_Y2=number_slider_31,
    BldA_X3=number_slider_27,
    BldA_Y3=number_slider_19,
    BldA_X4=number_slider_23,
    BldA_Y4=number_slider_28,
    BldB_X1=number_slider_24,
    BldB_Y1=number_slider_20,
    BldB_X2=number_slider_7,
    BldB_Y2=number_slider_15,
    BldB_X3=number_slider_18,
    BldB_Y3=number_slider_32,
    BldB_X4=number_slider_14,
    BldB_Y4=number_slider_9,
    BldC_X1=number_slider_11,
    BldC_Y1=number_slider_16,
    BldC_X2=number_slider_12,
    BldC_Y2=number_slider_10,
    BldC_X3=number_slider_5,
    BldC_Y3=number_slider_8,
    BldC_X4=number_slider_13,
    BldC_Y4=number_slider_34,
    BldD_X1=number_slider_6,
    BldD_Y1=number_slider_35,
    BldD_X2=number_slider_17,
    BldD_Y2=number_slider_21,
    BldD_X3=number_slider_26,
    BldD_Y3=number_slider_22,
    BldD_X4=number_slider_25)
framework_for_optimization_in_grasshoppe = FrOG01(
    Variables=[number_slider_3, number_slider_4, number_slider_2, number_slider, number_slider_30, number_slider_29, number_slider_33, number_slider_31, number_slider_27, number_slider_19, number_slider_23, number_slider_28, number_slider_24, number_slider_20, number_slider_7, number_slider_15, number_slider_18, number_slider_32, number_slider_14, number_slider_9, number_slider_11, number_slider_16, number_slider_12, number_slider_10, number_slider_5, number_slider_8, number_slider_13, number_slider_34, number_slider_6, number_slider_35, number_slider_17, number_slider_21, number_slider_26, number_slider_22, number_slider_25],
    Objective=prob15waibel)  # "Framework for Optimization in Grasshopper"

# ---- group: result
panel = Panel(prob15waibel)
