# Grasshopper definition WetterDetailedPara.gh (Grasshopper 0.9.76)
# plug-ins: GHEnergyPlus

# ---- group: parameters
number_slider = Slider(600, range=100..600)
number_slider_2 = Slider(200, range=100..600)
number_slider_3 = Slider(312.5, range=100..600)
number_slider_4 = Slider(5.832, range=1.224..5.832)
number_slider_5 = Slider(23.493, range=7.344..25.668)
number_slider_6 = Slider(17.767, range=7.344..25.668)
number_slider_7 = Slider(5.832, range=1.224..5.832)
number_slider_8 = Slider(12, range=12..18)
number_slider_9 = Slider(24.95, range=20..25)
number_slider_10 = Slider(24, range=20..25)
number_slider_11 = Slider(0.194, range=0.05..1.05)
number_slider_12 = Slider(1.016, range=0.05..1.05)
number_slider_13 = Slider(0.719, range=0.05..1.05)

# ---- group: run it
toggle = BooleanToggle(False)

# ---- group: weather file
panel = Panel("USA_WA_Seattle-Tacoma.727930_TMY2")

# ---- group: idf file
panel_2 = Panel("detailed_template_seattle")

# ----
wetterdetailedpara = WetterDetailedPara(
    Idf=panel_2,
    Weather=panel,
    Run=toggle,
    WindowLN=number_slider_7,
    WindowLW=number_slider_6,
    WindowLE=number_slider_5,
    WindowLS=number_slider_4,
    OverhangW=number_slider_13,
    OverhangE=number_slider_12,
    OverhangS=number_slider_11,
    ShadingW=number_slider_3,
    ShadingE=number_slider_2,
    ShadingS=number_slider,
    SetpointNightSummer=number_slider_10,
    SetpointNightWinter=number_slider_9,
    CoolingSupplyTemp=number_slider_8)

# ---- group: result
panel_3 = Panel(wetterdetailedpara)
