# Grasshopper definition WetterDetailedSobol.gh (Grasshopper 0.9.76)
# plug-ins: GHEnergyPlus

wetterdetailedsobol = WetterDetailedSobol(
    IdfFile="detailed_template",
    WeatherFile="USA_IL_Chicago-OHare.Intl.AP.725300_TMY3",
    PathLPtSequence="C:\eplus\SimAud17\Input\sobol.csv",
    Run=Toggle(False))
